# Grasshopper definition graphVisualiser.gh (Grasshopper 1.0.7)
# plug-ins: SpaceSyntaxDesign_GH

# ---- group: Input
section_num = Slider(2, range=-1..20)
area_multiplier = Slider(0.314, range=0.001..1)
scheme_size = Slider(16, range=0..50)
show_sections = BooleanToggle(False)
path = FilePath("D:\Documents\Uni\Thesis\sources\Models\exports\Exported_AC-20-Smiley-West-10-Bldg_graph.txt")

# ----
file = ReadFile(File=path, PerLineParse=True)
c_script = CSharpScript(x=file, y=section_num, z=show_sections)  # -> P, L1, L2, T, A, S, E; inputs x: list of String, y: String, z: Boolean
# ---------- c_script: C# ----------
    List<List<string>> faces = new List<List<string>> ();
    Grasshopper.DataTree<string> tree = new Grasshopper.DataTree<string>();

    int sp = 0;
    int sn = 0;
    int sc = 0;
    int sa = 0;
    int ss = 0;

    List<string> points = new List <string> ();
    List<string> names = new List <string> ();
    List<string> curves1 = new List <string> ();
    List<string> curves2 = new List <string> ();
    List<string> areas = new List <string> ();
    List<bool> sections = new List <bool> ();
    List<string> sectionNums = new List <string> ();

    List<string> pointsf = new List <string> ();
    List<string> namesf = new List <string> ();
    List<string> curves1f = new List <string> ();
    List<string> curves2f = new List <string> ();
    List<string> areasf = new List <string> ();

    List<string> errorOutput = new List <string> ();

    bool indxFound = false;

    for (int i = 0; i < x.Count; i++){
      if (x[i] == "_pointList_") { sp = i; }
      if (x[i] == "_name_") { sn = i; }
      if (x[i] == "_connection_") { sc = i; }
      if (x[i] == "_area_") { sa = i; }
      if (x[i] == "_sections_") { ss = i; }
    }

    for (int i = sp + 1; i < sn; i++){ points.Add(x[i]); }
    for (int i = sn + 1; i < sa; i++){ names.Add(x[i]); }
    for (int i = sa + 1; i < sc; i++){ areas.Add(x[i]); }
    for (int i = sc + 1; i < ss; i++)
    {
      string phrase = x[i];
      string[] indx = phrase.Split(',');

      curves1.Add(indx[0]);
      curves2.Add(indx[1]);
    }

    for (int i = ss + 1; i < x.Count; i++) {
      if (x[i] == y) {
        indxFound = true;
        break;
      }
    }

    for (int i = ss + 1; i < x.Count; i++) {
        sectionNums.Add(x[i]);

      if (x[i] == y || x[i] == "-2")
      {
        sections.Add(true);
      }
      else {
        sections.Add(false);
      }
    }

    if (!z)
    {
      P = points;
      L1 = curves1;
      L2 = curves2;
      T = names;
      A = areas;
      S = sectionNums;
    }
    else {
      List<int> originalPIndx = new List <int> ();

      for (int i = 0; i < sections.Count; i++){
        if (sections[i])
        {
          pointsf.Add(points[i]);
          namesf.Add(names[i]);
          areasf.Add(areas[i]);
          originalPIndx.Add(i);
        }
      }
      for (int i = 0; i < originalPIndx.Count; i++)
      {
        for (int j = 0; j < curves1.Count; j++)
        {
          if(int.Parse(curves1[j]) == originalPIndx[i])
          {
            for (int k = 0; k < originalPIndx.Count; k++)
            {
              if(int.Parse(curves2[j]) == originalPIndx[k])
              {
                curves1f.Add(curves1[j]);
                curves2f.Add(curves2[j]);

                break;
              }
            }
          }
        }
      }
      int buffer = 0;
      for (int i = 0; i < points.Count; i++)
      {
        bool found = false;
        int correction = i + 1;
        for (int j = 0; j < curves1f.Count; j++)
        {
          if (int.Parse(curves1f[j]) == correction){
            found = true;

            for (int k = 0; k < curves1f.Count; k++)
            {
              if (int.Parse(curves1f[k]) == correction){
                curves1f[k] = (int.Parse(curves1f[k]) - buffer).ToString();
              }
            }

            for (int k = 0; k < curves2f.Count; k++)
            {
              if (int.Parse(curves2f[k]) == correction){
                curves2f[k] = (int.Parse(curves2f[k]) - buffer).ToString();
              }
            }
            break;
          }
        }

        if (!found){
          buffer = buffer + 1;
        }
      }
      P = pointsf;
      L1 = curves1f;
      L2 = curves2f;
      T = namesf;
      A = areasf;

      if (!indxFound)
      {
        errorOutput.Add("Index not present in graph file");
      }

      if (pointsf.Count != namesf.Count ||
        namesf.Count != areasf.Count ||
        curves1f.Count != curves2f.Count
        )
      {
        errorOutput.Add("invalid graph file");
      }

      if (errorOutput.Count == 0)
      {
        E = "";
      }
      else {
        E = errorOutput;
      }


    }
# ---------- end c_script ----------
panel = Panel(c_script.E)
multiplication = Multiplication(A=c_script.A, B=area_multiplier)
count_connections = CountConnections(l1=c_script.L1, l2=c_script.L2)
random_noise = RandomNoise(pt=c_script.P)
toline = ToLine(L=random_noise, i=c_script.L1, i_2=c_script.L2)
panel_2 = Panel(count_connections)
nodelinkgraph = GraphFromNodesLinks(Points=random_noise, Links=toline, Labels=c_script.T, Areas=multiplication)  # -> Graph, GraphVertices, Attributes
over_color = OverColor(att=nodelinkgraph.Attributes, relay=c_script.S, P=show_sections)
integration = IntegrationAnalysis(Graph=nodelinkgraph.Graph, Attributes=over_color)  # -> DepthTable, DepthMap, RelativeASymetry, Integration, IntegrationRelativeColors, IntegrationTags
forcedirecteddrawing = ForceDirectedDrawing(
    Graph=nodelinkgraph.Graph,
    Vertices=nodelinkgraph.GraphVertices,
    Attributes=nodelinkgraph.Attributes,
    AttractionStrength=0.25,
    RepulsionStrength=1.4,
    ConvergenceTolearnce=0.001,
    MaximumIterations=4000,
    Active=Toggle(False))  # -> NewGraphVertices, IterationCount
diskograph = DiskoGraphDrawing(
    Plane=PlaneXY(129.9582918, 21.27351938, 0),
    Graph=nodelinkgraph.Graph,
    Vertices=forcedirecteddrawing.NewGraphVertices,
    Attributes=over_color,
    Thickness=1)
justifiedgraph = JustifiedGraphDrawing(
    ViewPointIndex=0,
    Plane=PlaneXY(38.85476766, -0.1414173258, 0),
    Size=scheme_size,
    Thickness=1,
    Graph=nodelinkgraph.Graph,
    Attributes=over_color,
    DepthTable=integration.DepthTable)

# ==== cluster RandomNoise
pt = ClusterInput()
pt_2 = Point(pt)
lng = ListLength(List=pt_2)
random = Random(Range=Domain(0, 10), Number=lng, Seed=3)
random_2 = Random(Range=Domain(0, 10), Number=lng, Seed=2)
X = UnitX(Factor=random)
X_2 = UnitX(Factor=random_2)
move = Move(Geometry=pt_2, Motion=X_2)  # -> Geometry, Transform
move_2 = Move(Geometry=move.Geometry, Motion=X)  # -> Geometry, Transform
G = ClusterOutput(move_2.Geometry)

# ==== cluster ToLine
L = ClusterInput()
i = ClusterInput()
i_2 = ClusterInput()
item = ListItem(List=L, Index=i, Wrap=True)
item_2 = ListItem(List=L, Index=i_2, Wrap=True)
ln = Line(StartPoint=item, EndPoint=item_2)
L_2 = ClusterOutput(ln)

# ==== cluster CountConnections
l1 = ClusterInput()
l2 = ClusterInput()
c_script = CSharpScript(l1=l1, l2=l2)  # -> out, A; inputs l1: list of String, l2: list of String
# ---------- c_script: C# ----------
 
     List<string> list = new List <string> ();
    for (int i = 0; i < l1.Count; i++){
      string data1 = "";
      string data2 = "";
      foreach (var letter in l1[i])
      {
        if (letter != ' ')
        {
          data1 += letter;
        }
      }
      foreach (var letter in l2[i])
      {
        if (letter != ' ')
        {
          data2 += letter;
        }
      }
      
  
        list.Add(data1 + "-" + data2);
        list.Add(data2 + "-" + data1);
      
      }
    
      A = list;
# ---------- end c_script ----------
cset = CreateSet(List=c_script.A)  # -> Set, Map
lng = ListLength(List=cset.Set)
division = Division(A=lng, B=2)
R = ClusterOutput(division)

# ==== cluster OverColor
relay = ClusterInput()
P = ClusterInput()
att = ClusterInput()
sort = SortList(Keys=relay)  # -> Keys, ValuesA
item = ListItem(List=reverse(sort.Keys), Index="0", Wrap=True)
item_2 = ListItem(List=sort.Keys, Index="0", Wrap=True)
gradient = Gradient(
    LowerLimit=item_2,
    UpperLimit=item,
    Parameter=relay,
    stops=[0.00893: RGB(243, 57, 0), 0.1: RGB(236, 27, 60), 0.2: RGB(210, 0, 118), 0.3: RGB(103, 0, 120), 0.4: RGB(39, 72, 161), 0.5: RGB(1, 192, 229), 0.6: RGB(18, 178, 90), 0.7: RGB(79, 186, 8), 0.8: RGB(220, 237, 32), 0.9: RGB(247, 159, 20), 1: RGB(243, 57, 0)])
prgm = Programme(Attributes=att)  # -> Tags, Areas, Colors, Legends
prgm_2 = Programme(Attributes=att)  # -> Tags, Areas, Colors, Legends
lng = ListLength(List=prgm_2.Colors)
repeat = RepeatData(Data=ColourSwatch(SwatchColor=RGB(84, 144, 255)), Length=lng)
lol = LOL(Tags=prgm.Tags, Numbers=prgm.Areas, Colors=gradient)
cull = CullPattern(List=lol, CullPattern=invert(P))
pshift = ShiftPaths(Data=repeat, Offset=-1)
lol_2 = LOL(Tags=prgm_2.Tags, Numbers=prgm_2.Areas, Colors=pshift)
cull_2 = CullPattern(List=lol_2, CullPattern=P)
merge = Merge(Data1=cull_2, Data2=cull)
prgm_3 = Programme(Attributes=merge)  # -> Tags, Areas, Colors, Legends
panel = Panel(prgm_3.Tags)
att_2 = ClusterOutput(merge)
